# Grasshopper definition 160925_PE_points.gh (Grasshopper 0.9.76)

pi = Pi(Factor="2")
multiplication = Multiplication(A=Slider(0.707, range=0..1), B=pi)
number_slider = Slider(6, range=0..10)
number_slider_2 = Slider(5, range=0..10)
line_length = Panel("""3.2
5.1
6.3
4.2""")
panel = Panel("""0
1
2
3""")
dom = ConstructDomain(DomainStart=0, DomainEnd=multiplication)
# Point:indicate a position in space
# Line:length,direction,position
# Point
# two ends of the line
# the intersection of two lines
# the meeting of lines at the corner of a space or volumn
# the center of field
md_slider = MDSlider(
    slider_value=Point(0.5132578379, 0.5396976122, 0.5),
    SliderMode=0,
    x_domain=Domain(-100, 100),
    y_domain=Domain(-100, 100),
    z_domain=Domain(0, 1))
random = Random(Range=Domain(0, 1), Number=1, Seed=2)
Z = UnitZ(Factor=1)
series = Series(Start=0, Step=number_slider_2, Count=number_slider)
random_2 = Random(Range=dom, Number=number_slider, Seed=Slider(67.6, range=0..100))
vrot = Rotate(Axis=Z)
startpoint = Point(md_slider)
line_length_2 = Number(line_length)
multiplication_2 = Multiplication(A=number_slider_2, B=Slider(8, range=0..10))
int = Integer(panel)
xy = XYPlane(Origin=Point(0, 0, 0))
line = LineSDL(Direction=Vector(0, 0, 1), Length=1)
item = ListItem(List=["1,0", "0,1", "-1,0", "0,-1"], Index=int, Wrap=True)
Z_2 = UnitZ(Factor=1)
dom_2 = ConstructDomain(DomainStart=number_slider_2, DomainEnd=multiplication_2)
X = UnitX(Factor=1)
pt = PointOriented(BasePlane=xy, UComponent=series, VComponent=0, WComponent=0)
item_2 = ListItem(List=line_length_2, Index=0, Wrap=True)
X_2 = UnitX(Factor=1)
basicvector = Vector(item)
vrot_2 = Rotate(Vector=X, Axis=Z_2, Angle=random_2)
random_3 = Random(Range=dom_2, Number=number_slider, Seed=Slider(65.8, range=0..100))
merge = Merge(Data1=Slider(0.52, range=0..100), Data2=Slider(2.4, range=0..100))
merge_2 = Merge(Data1=Slider(7.61, range=0..100), Data2=Slider(6.19, range=0..100))
amp = Amplitude(Vector=vrot_2, Amplitude=random_3)
amp_2 = Amplitude(Vector=X_2, Amplitude=item_2)
line_2 = LineSDL(Start=startpoint, Direction=X_2, Length=item_2)
complex = ComplexComponents(Complex=startpoint)  # -> Real, Imaginary
pt_2 = PointOriented(BasePlane=startpoint, UComponent=merge, VComponent=merge_2, WComponent=0)
complex_2 = ComplexComponents(Complex=amp_2)  # -> Real, Imaginary
panel_2 = Panel("""1,2
2,1""")
panel_3 = Panel("""2.0,2.0,0.0
-0.5,4.0,0.0""")
complex_3 = CreateComplex(Real=complex.Real, Imaginary=complex.Imaginary)
complex_4 = CreateComplex(Real=complex_2.Real, Imaginary=complex_2.Imaginary)
item_3 = ListItem(List=pt_2, Index=0, Wrap=True)  # -> Item, Item1
X_3 = UnitX(Factor=1)
Y = UnitY(Factor=1)
addition = Addition(A=complex_3, B=complex_4)
startpoint_2 = Point(panel_2)
startpoint_3 = Point(startpoint_2)
vec = Vector(panel_3)
vec_2 = Vector(vec)
addition_2 = Addition(A=startpoint_3, B=vec_2)

ln = Line(StartPoint=startpoint_3, EndPoint=addition_2)
line_3 = Line([Line((-24.54200088, -22.58083959, 0), (5.760638928, -14.29177669, 0)), Line((-23.45491066, -39.29485168, 0), (17.58274504, -19.59134149, 0)), Line((-11.22514572, -8.584553045, 0), (-17.8835733, -42.96378116, 0)), Line((-1.98487887, -5.730941225, 0), (14.18558811, -37.93598891, 0)), Line((17.03919993, -26.65742791, 0), (-21.55250278, -41.87669095, 0)), Line((-19.92186745, -25.70622397, 0), (10.65254491, -42.28434978, 0))])
linelist = Curve(ln)
lng = ListLength(List=linelist)
subtraction = Subtraction(A=lng, B="1")
series_2 = Series(Start=0, Step=1, Count=subtraction)
addition_3 = Addition(A=series_2, B="1")
item_4 = ListItem(List=linelist, Index=series_2, Wrap=False)  # -> simplify(graft(Item))
shift = ShiftList(List=linelist, Shift=addition_3, Wrap=False)  # -> simplify(List)
end = EndPoints(Curve=item_4)  # -> Start, End
end_2 = EndPoints(Curve=shift)  # -> Start, End

lng_2 = ListLength(List=addition_2)
lng_3 = ListLength(List=startpoint_3)
line_4 = LineSDL(Start=item_3.Item1, Direction=Y, Length=item_2)
line_5 = LineSDL(Start=item_3.Item, Direction=X_3, Length=item_2)
subtraction_2 = Subtraction(A=lng_2, B="1")
panel_4 = Panel(addition)
subtraction_3 = Subtraction(A=lng_3, B="1")
addition_4 = Addition(A=startpoint_2, B=vec)
vec2pt = Vector2Pt(PointA=startpoint_2, PointB=addition_4, Unitize=False)  # -> Vector, Length
ln_2 = Line(StartPoint=startpoint_2, EndPoint=addition_4)
series_3 = Series(Start=0, Step=1, Count=subtraction_2)
series_4 = Series(Start=0, Step=1, Count=subtraction_3)
endpoint = Point(addition_4)
panel_5 = Panel(complex_3)
addition_5 = Addition(A=series_3, B="1")
addition_6 = Addition(A=series_4, B="1")
item_5 = ListItem(List=addition_2, Index=series_3, Wrap=False)  # -> simplify(graft(Item))
item_6 = ListItem(List=startpoint_3, Index=series_4, Wrap=False)  # -> simplify(graft(Item))
shift_2 = ShiftList(List=addition_2, Shift=addition_5, Wrap=False)  # -> simplify(List)
shift_3 = ShiftList(List=startpoint_3, Shift=addition_6, Wrap=False)  # -> simplify(List)
firstpt0 = Point(item_6)
firstpt1 = Point(shift_3)
endpt0 = Point(item_5)
endpt1 = Point(shift_2)
firstpt0_2 = Point(firstpt0)
firstpt1_2 = Point(firstpt1)
endpt0_2 = Point(endpt0)
endpt1_2 = Point(endpt1)
complex_5 = ComplexComponents(Complex=firstpt1_2)  # -> Real, Imaginary
complex_6 = ComplexComponents(Complex=endpt1_2)  # -> Real, Imaginary
complex_7 = ComplexComponents(Complex=endpt0_2)  # -> Real, Imaginary
complex_8 = ComplexComponents(Complex=firstpt0_2)  # -> Real, Imaginary
points = PointList(Points=flatten(firstpt0_2), Size=Slider(2, range=0..100))
subtraction_4 = Subtraction(A=complex_8.Real, B=complex_7.Real)
subtraction_5 = Subtraction(A=complex_8.Imaginary, B=complex_7.Imaginary)
subtraction_6 = Subtraction(A=complex_5.Real, B=complex_6.Real)
subtraction_7 = Subtraction(A=complex_5.Imaginary, B=complex_6.Imaginary)
division = Division(A=subtraction_5, B=subtraction_4)
division_2 = Division(A=subtraction_7, B=subtraction_6)
k2 = Number(division_2)
k1 = Number(division)
multiplication_3 = Multiplication(A=k2, B=complex_6.Real)
multiplication_4 = Multiplication(A=k1, B=complex_7.Real)
subtraction_8 = Subtraction(A=complex_7.Imaginary, B=multiplication_4)
subtraction_9 = Subtraction(A=complex_6.Imaginary, B=multiplication_3)
b1 = Number(subtraction_8)
b2 = Number(subtraction_9)
subtraction_10 = Subtraction(A=b2, B=b1)
subtraction_11 = Subtraction(A=k1, B=k2)
division_3 = Division(A=subtraction_10, B=subtraction_11)

# ----
# 0 --> extend one line to intersect two lines
# 1 --> extend two lines
# 2 --> extend three lines
dom_3 = ConstructDomain(DomainStart=complex_5.Real, DomainEnd=complex_6.Real)
dom_4 = ConstructDomain(DomainStart=complex_8.Real, DomainEnd=complex_7.Real)
inc = Includes(Value=division_3, Domain=dom_4)  # -> Includes, Deviation
inc_2 = Includes(Value=division_3, Domain=dom_3)  # -> Includes, Deviation
int_2 = Integer(inc.Includes)
int_3 = Integer(inc_2.Includes)
addition_7 = Addition(A=int_2, B=int_3)
subtraction_12 = Subtraction(A="2", B=addition_7)
extendlinecount = Integer(subtraction_12)

multiplication_5 = Multiplication(A=division_3, B=k2)
addition_8 = Addition(A=multiplication_5, B=b2)
intersection_x = Number(division_3)
intersection_y = Number(addition_8)
xy_2 = XYPlane(Origin=Point(0, 0, 0))
pt_3 = PointOriented(BasePlane=xy_2, UComponent=intersection_x, VComponent=intersection_y, WComponent=0)
sift = SiftPattern(List=pt_3, SiftPattern=extendlinecount)  # -> Output0, Output1, Output2
intersectionontwolines = Point(sift.Output0)
intersectionononeline = Point(sift.Output1)
intersectiononextend = Point(sift.Output2)
panel_6 = Panel(extendlinecount)
