# Grasshopper definition 160929_PE_points_intersection_007_vectorArrangement.gh (Grasshopper 0.9.76)

# ----
# kernel intersection algorithm 001_trial
line_length = Panel("""3.2
5.1
6.3
4.2""")
panel = Panel("""0
1
2
3""")
# Point:indicate a position in space
# Line:length,direction,position
# Point
# two ends of the line
# the intersection of two lines
# the meeting of lines at the corner of a space or volumn
# the center of field
md_slider = MDSlider(
    slider_value=Point(0.5132578379, 0.5396976122, 0.5),
    SliderMode=0,
    x_domain=Domain(-100, 100),
    y_domain=Domain(-100, 100),
    z_domain=Domain(0, 1))  # disabled
line_length_2 = Number(line_length)
startpoint = Point(md_slider)  # disabled
int = Integer(panel)
number_slider = Slider(6.19, range=0..100)  # disabled
number_slider_2 = Slider(0.52, range=0..100)  # disabled
number_slider_3 = Slider(2.4, range=0..100)  # disabled
number_slider_4 = Slider(7.61, range=0..100)  # disabled
item = ListItem(List=["1,0", "0,1", "-1,0", "0,-1"], Index=int, Wrap=True)
item_2 = ListItem(List=line_length_2, Index=0, Wrap=True)
X = UnitX(Factor=1)
basicvector = Vector(item)
merge = Merge(Data1=number_slider_2, Data2=number_slider_3)  # disabled
merge_2 = Merge(Data1=number_slider_4, Data2=number_slider)  # disabled
amp = Amplitude(Vector=X, Amplitude=item_2)  # disabled
line = LineSDL(Start=startpoint, Direction=X, Length=item_2)  # disabled
complex = ComplexComponents(Complex=startpoint)  # -> Real, Imaginary; disabled
pt = PointOriented(BasePlane=startpoint, UComponent=merge, VComponent=merge_2, WComponent=0)  # disabled
complex_2 = ComplexComponents(Complex=amp)  # -> Real, Imaginary; disabled
complex_3 = CreateComplex(Real=complex.Real, Imaginary=complex.Imaginary)  # disabled
complex_4 = CreateComplex(Real=complex_2.Real, Imaginary=complex_2.Imaginary)  # disabled
item_3 = ListItem(List=pt, Index=0, Wrap=True)  # -> Item, Item1; disabled
X_2 = UnitX(Factor=1)  # disabled
Y = UnitY(Factor=1)  # disabled
addition = Addition(A=complex_3, B=complex_4)  # disabled
line_2 = LineSDL(Start=item_3.Item1, Direction=Y, Length=item_2)  # disabled
line_3 = LineSDL(Start=item_3.Item, Direction=X_2, Length=item_2)  # disabled
panel_2 = Panel(addition)  # disabled
panel_3 = Panel("""1,2
2,1""")  # disabled
panel_4 = Panel("""2.0,2.0,0.0
-0.5,4.0,0.0""")  # disabled
panel_5 = Panel(complex_3)  # disabled
startpoint_2 = Point(panel_3)  # disabled
vec = Vector(panel_4)  # disabled
addition_2 = Addition(A=startpoint_2, B=vec)  # disabled
vec2pt = Vector2Pt(PointA=startpoint_2, PointB=addition_2, Unitize=False)  # -> Vector, Length; disabled
ln = Line(StartPoint=startpoint_2, EndPoint=addition_2)  # disabled
endpoint = Point(addition_2)  # disabled

# ----
# kernel intersection algorithm 002_siftPoint
line_4 = Line([Line((-28.43570879, -32.87535514, 0), (26.13975502, -11.96140003, 0)), Line((18.7700756, 6.164027732, 0), (13.19302091, -43.43192296, 0)), Line((-30.62669456, -19.7294405, 0), (35.30205917, -38.25322931, 0)), Line((2.835633616, -1.404832213, 0), (-1.54633793, -45.62290873, 0))])  # disabled
panel_6 = Panel("1")  # disabled
linelist = Curve(line_4)  # disabled
lng = ListLength(List=linelist)  # disabled
subtraction = Subtraction(A=lng, B=panel_6)  # disabled
series = Series(Start=0, Step=1, Count=subtraction)  # disabled
addition_3 = Addition(A=series, B=panel_6)  # disabled
item_4 = ListItem(List=linelist, Index=series, Wrap=False)  # -> simplify(graft(Item)); disabled
shift = ShiftList(List=linelist, Shift=addition_3, Wrap=False)  # -> simplify(List); disabled
end = EndPoints(Curve=item_4)  # -> Start, End; disabled
end_2 = EndPoints(Curve=shift)  # -> Start, End; disabled

num = Number(Toggle(False))
line_5 = Line(Line((119.3393443, -60.78584412, 0), (119.6525493, -60.78584412, 0)))
line_6 = Line(Line((119.8096632, -60.78584412, 0), (119.4931182, -60.78584412, 0)))
panel_7 = Panel("运算器存在bug")
ccx = CurveCurve(CurveA=line_5, CurveB=line_6)  # -> Points, ParamsA, ParamsB
line_bug_commonline = Line([Line((119.3540923, -60.56923774, 0), (119.5008735, -60.56923774, 0)), Line((119.5919791, -60.56923774, 0), (119.7404475, -60.56923774, 0))])
# debug:之前判断是实交和虚交的方法是判断交点point的x坐标是否在两线段的值域范围内，但是当上述情况的时候，直线会虚交被误判成实际交点
line_bug_insectiononextend = Line([Line((119.0174668, -60.28107794, 0), (119.4638718, -60.28107794, 0)), Line((119.2255633, -60.35451331, 0), (119.2255633, -61.15203638, 0))])
# log:
# 20161010
# 设计向量方向与数据结构之间的映射关系
# 分离对应的算法，让算法之间有通过也有分离
# 线线重合的问题解决后先放在一旁
# 数据结构的替换，在最后做
line_7 = Line([Line((119.5723897, -60.99532941, 0), (119.5723897, -61.13933165, 0)), Line((119.5723897, -60.99532941, 0), (119.7626783, -60.99532941, 0))])
panel_8 = Panel("把正交和斜交的情况分离开来，同时组织数据结构")
panel_9 = Panel("描述方法只是数据结构的不同，先用几何代表抽象的数据结构")
panel_10 = Panel("""多条线且含有多折线连线组织数据结构问题
得到交点
交点的path替换""")
panel_11 = Panel("""x0,y0;0,1,2,3
x1,y0;0,3,2""")
crv = Curve([<curve referenced from the Rhino model> x3])
crv_2 = Curve([<curve referenced from the Rhino model> x4])
explode = Explode(Curve=crv_2, Recursive=True)  # -> Segments, Vertices
end_3 = EndPoints(Curve=crv_2)  # -> Start, End
neg = Negative(Value="1")
shift_2 = ShiftList(List=explode.Vertices, Shift="1", Wrap=False)
shift_3 = ShiftList(List=explode.Vertices, Shift=neg, Wrap=False)

panel_12 = Panel("""1,0
0,1
-1,0
0,-1""")
vec_2 = Vector(panel_12)

# ----
# describe space by (point;index) of vector
md_slider_2 = MDSlider(
    slider_value=Point(0.5591201782, 0.4691162109, 0.5),
    SliderMode=0,
    x_domain=Domain(-1000, 1000),
    y_domain=Domain(-1000, 1000),
    z_domain=Domain(0, 1))
panel_13 = Panel("""0
1
2
3""")
line_length_3 = Panel("""3.2
5.1
3.2
5.1""")
line_length_4 = Number(line_length_3)
int_2 = Integer(panel_13)
lng_2 = ListLength(List=int_2)
series_2 = Series(Start=0, Step=1, Count=lng_2)
item_5 = ListItem(List=vec_2, Index=int_2, Wrap=True)
item_6 = ListItem(List=line_length_4, Index=series_2, Wrap=True)
basicvectorunit = Vector(item_5)
amp_2 = Amplitude(Vector=basicvectorunit, Amplitude=item_6)
ma = MassAddition(Input=amp_2)  # -> Result, PartialResults
addition_4 = Addition(A=md_slider_2, B=ma.PartialResults)
pt_2 = Point(addition_4)
shift_4 = ShiftList(List=ma.PartialResults, Shift=-1, Wrap=True)
complex_5 = ComplexComponents(Complex=shift_4)  # -> Real, Imaginary
concat = Concatenate(FragmentA=complex_5.Real, FragmentB=complex_5.Imaginary, JoinSeparator=",")
pline = PolyLine(Vertices=pt_2, Closed=True)
concat_2 = Concatenate(FragmentA=concat, FragmentB=int_2, JoinSeparator=";")

subtraction_2 = Subtraction(A=shift_2, B=shift_3)

# ----
# 首点坐标相对于第一点
graft = GraftTree(Tree=end_3.Start, IncludeEmptyLists=True, IncludeNullItems=True)  # -> simplify(Tree)
subtraction_3 = Subtraction(A=graft, B="{0,0,0}")  # -> flatten(Result)
item_7 = ListItem(List=subtraction_3, Index="0", Wrap=True)
subtraction_4 = Subtraction(A=graft, B=item_7)

# ----
# curve convert to direction and length
unit = UnitVector(Vector=subtraction_2)
vec_3 = Vector(subtraction_2)
len = Length(Curve=explode.Segments)  # -> simplify(Length)
pshift = ShiftPaths(Data=unit, Offset=-1)
mindex = MemberIndex(Set=vec_2, Member=pshift)  # -> Index, Count
vdis = VectorDisplay(Anchor=shift_3, Vector=vec_3)
pshift_2 = ShiftPaths(Data=mindex.Index, Offset=-1)  # -> simplify(Data)

vecdirection = Integer(pshift_2)
veclength = Number(len)
pt_3 = Point(graft)

panel_14 = Panel(vec_2)
item_8 = ListItem(List=vec_2, Index=vecdirection, Wrap=True)
amp_3 = Amplitude(Vector=item_8, Amplitude=veclength)
ma_2 = MassAddition(Input=amp_3)  # -> Result, PartialResults
addition_5 = Addition(A=pt_3, B=ma_2.PartialResults)
pt_4 = Point(addition_5)
ins = InsertItems(List=addition_5, Item=pt_3, Indices="0", Wrap=True)
neg_2 = Negative(Value="1")
panel_15 = Panel(concat_2)
panel_16 = Panel(pt_3)
panel_17 = Panel(amp_2)
panel_18 = Panel(ins)
# each line first point
shift_5 = ShiftList(List=ins, Shift=neg_2, Wrap=False)  # -> simplify(List)

# ----
# tree data trial
# first point 和 end point 的数据结构组织的方式是同一种的
# 
# 先手工傻做，再寻找规律
# 
# 先不管结构如何，把他们放在一起，结构在外部运算，在替换成对的树形数据
# 上升数据结构后手工或者数列
# 上升后全部拍平处理
# 用stack+listItem对拍平的数据处理
# 
# 留下来的问题是数据结构的替换
# 手工
pt_5 = Point(shift_5)
graft_2 = GraftTree(Tree=pt_5, IncludeEmptyLists=True, IncludeNullItems=True)

panel_19 = Panel(pt_5)

flatten = FlattenTree(Tree=graft_2, Path="{0}")
tstat = TreeStatistics(Tree=pt_5)  # -> Paths, Length, Count
tstat_2 = TreeStatistics(Tree=graft_2)  # -> Paths, Length, Count
ma_3 = MassAddition(Input=tstat.Length)  # -> Result, PartialResults
series_3 = Series(Start=0, Step=1, Count=tstat_2.Count)
stack = StackData(Data=ma_3.PartialResults, Stack=tstat.Length)
shift_6 = ShiftList(List=series_3, Shift=stack, Wrap=False)
item_9 = ListItem(List=flatten, Index=shift_6, Wrap=True)  # -> simplify(Item)

panel_20 = Panel(tstat.Length)
lng_3 = ListLength(List=item_9)
panel_21 = Panel(graft_2)
stack_2 = StackData(Data=graft_2, Stack=lng_3)

bang = ExplodeTree(Data=graft_2)  # -> Branch0, Branch1, Branch2, Branch3, Branch4, Branch5
merge_3 = Merge(Data1=bang.Branch1, Data2=bang.Branch2, Data3=bang.Branch3, Data4=bang.Branch4, Data5=bang.Branch5)
entwine = Entwine(
    Branch00=merge_3,
    Branch01=bang.Branch5,
    Branch02=bang.Branch5,
    Branch03=bang.Branch5,
    Branch04=bang.Branch5,
    FlattenInputs=True)

# ----
# each line end point
shift_7 = ShiftList(List=ins, Shift="1", Wrap=False)  # -> simplify(List)
graft_3 = GraftTree(Tree=stack_2, IncludeEmptyLists=True, IncludeNullItems=True)
graft_4 = GraftTree(Tree=shift_5, IncludeEmptyLists=True, IncludeNullItems=True)

flatten_2 = FlattenTree(Tree=graft_4, Path="{0}")
tstat_3 = TreeStatistics(Tree=shift_5)  # -> Paths, Length, Count
tstat_4 = TreeStatistics(Tree=graft_4)  # -> Paths, Length, Count
ma_4 = MassAddition(Input=tstat_3.Length)  # -> Result, PartialResults
series_4 = Series(Start=0, Step=1, Count=tstat_4.Count)
stack_3 = StackData(Data=ma_4.PartialResults, Stack=tstat_3.Length)
shift_8 = ShiftList(List=series_4, Shift=stack_3, Wrap=False)
viewer = ParamViewer()
item_10 = ListItem(List=flatten_2, Index=shift_8, Wrap=True)  # -> simplify(Item)
replace = ReplacePaths(Data=item_10, Search=viewer)

graft_5 = GraftTree(Tree=shift_7, IncludeEmptyLists=True, IncludeNullItems=True)

# ----
# kernel tree data
flatten_3 = FlattenTree(Tree=graft_5, Path="{0}")
tstat_5 = TreeStatistics(Tree=shift_7)  # -> Paths, Length, Count
tstat_6 = TreeStatistics(Tree=graft_5)  # -> Paths, Length, Count
ma_5 = MassAddition(Input=tstat_5.Length)  # -> Result, PartialResults
series_5 = Series(Start=0, Step=1, Count=tstat_6.Count)
stack_4 = StackData(Data=ma_5.PartialResults, Stack=tstat_5.Length)
shift_9 = ShiftList(List=series_5, Shift=stack_4, Wrap=False)
item_11 = ListItem(List=flatten_3, Index=shift_9, Wrap=True)  # -> simplify(Item)
viewer_2 = ParamViewer()
replace_2 = ReplacePaths(Data=item_11, Search=viewer_2)

panel_22 = Panel(item_9)
addition_6 = Addition(A=pt_3)

viewer_3 = ParamViewer()
replace_3 = ReplacePaths(Data=item_9, Search=viewer_3)

firstpt_line0 = Point(graft_4)
firstpt_line1 = Point(item_10)
endpt_line0 = Point(graft_5)
endpt_line1 = Point(item_11)

panel_23 = Panel(item_10)
graft_6 = GraftTree(Tree=item_9, IncludeEmptyLists=True, IncludeNullItems=True)
panel_25 = Panel(graft_6)
pi = Pi(Factor="2")
random = Random(Range=pi, Number="20", Seed=Slider(33.222, range=0..100))
panel_27 = Panel(pi)
sort = SortList(Keys=random)  # -> Keys, ValuesA
panel_28 = Panel(sort.Keys)

# ----
# 计算点到边界的垂直向量
# describe space by (point;index) of vector
# 问题在于，当某一path缺少时，替换的内容仍然会配对，造成数据多余错误
# 要探测出缺少的路径
# statistics-->DePath
# 最后拍平后替换路径
line_length_5 = Panel("""3.2
5.1
3.2
5.1
6.4
10.2""")
panel_29 = Panel("""0
1
0
1
2
3""")
md_slider_3 = MDSlider(
    slider_value=Point(0.4899997711, 0.4549980164, 0.5),
    SliderMode=0,
    x_domain=Domain(0, 1),
    y_domain=Domain(0, 1),
    z_domain=Domain(0, 1))
panel_30 = Panel("""0
1
2
3""")
line_length_6 = Panel("""3.2
5.1
3.2
5.1""")
panel_31 = Panel("""用字符串的方法表示还差最后一步，那么先拆开来用判断的方法做
拆开的方法很繁琐，索性还是用字符串替换的方法
检查目前的替换方法是否可以简化
并且找出到各个边的距离最近点""")
line_length_7 = Number(line_length_6)
panel_32 = Panel("""1,0
0,1
-1,0
0,-1""")
vec_4 = Vector(panel_32)
int_3 = Integer(panel_30)
lng_4 = ListLength(List=int_3)
series_6 = Series(Start=0, Step=1, Count=lng_4)
item_12 = ListItem(List=vec_4, Index=int_3, Wrap=True)
panel_33 = Panel(item_12)
item_13 = ListItem(List=line_length_7, Index=series_6, Wrap=True)
basicvectorunit_2 = Vector(item_12)
amp_4 = Amplitude(Vector=basicvectorunit_2, Amplitude=item_13)
ma_6 = MassAddition(Input=amp_4)  # -> Result, PartialResults
addition_7 = Addition(A=md_slider_3, B=ma_6.PartialResults)
shift_10 = ShiftList(List=ma_6.PartialResults, Shift=-1, Wrap=True)
complex_6 = ComplexComponents(Complex=shift_10)  # -> Real, Imaginary
concat_3 = Concatenate(FragmentA=complex_6.Real, FragmentB=complex_6.Imaginary, JoinSeparator=",")
item_14 = ListItem(List=amp_4, Index=graft(series_6), Wrap=True)
panel_34 = Panel(ma_6.PartialResults)
concat_4 = Concatenate(FragmentA=concat_3, FragmentB=int_3, JoinSeparator=";")
item_15 = ListItem(List=concat_4, Index=series_6, Wrap=True)
split = TextSplit(Text=item_15, Separators=";")  # -> simplify(Result)
item_16 = ListItem(List=split, Index=0, Wrap=True)  # -> Item, Item1
pt_6 = Point(item_16.Item)
addition_8 = Addition(A=pt_6, B=item_14)
firstpt0 = Point(item_16.Item)
endpt0 = Point(addition_8)
panel_35 = Panel(concat_4)
complex_7 = ComplexComponents(Complex=endpt0)  # -> Real, Imaginary
complex_8 = ComplexComponents(Complex=firstpt0)  # -> Real, Imaginary
pt_7 = Point(Point(1.488717773, 12.13872048, 0))
subtraction_5 = Subtraction(A=complex_8.Imaginary, B=complex_7.Imaginary)
subtraction_6 = Subtraction(A=complex_8.Real, B=complex_7.Real)
complex_9 = ComplexComponents(Complex=pt_7)  # -> Real, Imaginary
division = Division(A=subtraction_5, B=subtraction_6)
k1 = Number(division)
multiplication = Multiplication(A=k1, B=complex_7.Real)
subtraction_7 = Subtraction(A=complex_7.Imaginary, B=multiplication)
b1 = Number(subtraction_7)
panel_36 = Panel("abs(k*x0-y0+b)/sqrt(k*k+1)")
panel_37 = Panel("(k*x0-y0+b)/sqrt(k*k+1)")
panel_38 = Panel("-(k*x0-y0+b)/sqrt(k*k+1)")

x = Number(complex_9.Real)
y = Number(complex_9.Imaginary)
larger = LargerThan(FirstNumber=complex_8.Real, SecondNumber=x)  # -> LargerThan, OrEqualTo
larger_2 = LargerThan(FirstNumber=complex_8.Imaginary, SecondNumber=y)  # -> LargerThan, OrEqualTo
int_4 = Integer(larger.LargerThan)
int_5 = Integer(larger_2.LargerThan)
concat_5 = Concatenate(FragmentA=int_4, FragmentB=int_5)

# ---- group: vector match concept Error
panel_39 = Panel("""010
012
110
112""")
panel_40 = Panel("""101
103
111
113""")
panel_41 = Panel("""001
003
011
013""")
panel_42 = Panel("""000
002
100
102""")
merge_4 = Merge(Data1=panel_40, Data2=panel_39, Data3=panel_41, Data4=panel_42)
entwine_2 = Entwine(Branch00=panel_40, Branch01=panel_39, Branch02=panel_41, Branch03=panel_42, FlattenInputs=True)  # -> simplify(Result)
concat_6 = Concatenate(FragmentA=concat_5, FragmentB=item_16.Item1)
flatten_4 = FlattenTree(Tree=concat_6, Path="{0}")
mindex_2 = MemberIndex(Set=merge_4, Member=flatten_4)  # -> Index, Count
division_2 = Division(A=mindex_2.Index, B="4")
int_6 = Integer(division_2)
item_17 = ListItem(List=vec_4, Index=int_6, Wrap=True)

# ----
pt_8 = Point(ma_6.PartialResults)
pline_2 = PolyLine(Vertices=pt_8, Closed=True)

# ---- group: vector match concept Error
mindex_3 = MemberIndex(Set=entwine_2, Member=flatten_4)  # -> Index, Count
clean = CleanTree(RemoveNulls=True, RemoveInvalid=True, RemoveEmpty=True, Tree=mindex_3.Index)
tstat_7 = TreeStatistics(Tree=clean)  # -> Paths, Length, Count
split_2 = TextSplit(Text=tstat_7.Paths, Separators=";")
item_18 = ListItem(List=split_2, Index="0", Wrap=True)
split_3 = TextSplit(Text=item_18, Separators="{")
item_19 = ListItem(List=split_3, Index="1", Wrap=True)  # -> simplify(Item)

equals = Equality(FirstNumber=graft(flatten_4), SecondNumber=merge_4)  # -> Equality, Inequality
mindex_4 = MemberIndex(Set=equals.Equality, Member=Toggle(True))  # -> Index, Count

# ----
# distances between points and space boundary
null = NullItem(Item=k1)  # -> NullFlags, InvalidFlags, Description
sift = SiftPattern(List=pt_6, SiftPattern=null.NullFlags)  # -> Output0, Output1
complex_10 = ComplexComponents(Complex=sift.Output1)  # -> Real, Imaginary
eval = Evaluate(F="abs(k*x0-y0+b)/sqrt(k*k+1)", k=k1, b=b1, x0=complex_9.Real, y0=complex_9.Imaginary)
subtraction_8 = Subtraction(A=complex_9.Real, B=complex_10.Real)  # -> simplify(Result)
distance = Number(eval)
abs = Absolute(Value=subtraction_8)  # -> simplify(Result)
combine = CombineData(Input0=distance, Input1=abs)  # -> Result, Index

# ---- group: vector match method 1
concat_7 = Concatenate(FragmentA=concat_5, FragmentB=item_16.Item1)
flatten_5 = FlattenTree(Tree=concat_7, Path="{0}")
panel_43 = Panel("""000
002
100
102""")
panel_44 = Panel("""101
103
111
113""")
panel_45 = Panel("""010
012
110
112""")
panel_46 = Panel("""001
003
011
013""")
mindex_5 = MemberIndex(Set=panel_46, Member=flatten_5)  # -> Index, Count
mindex_6 = MemberIndex(Set=panel_43, Member=flatten_5)  # -> Index, Count
mindex_7 = MemberIndex(Set=panel_44, Member=flatten_5)  # -> Index, Count
mindex_8 = MemberIndex(Set=panel_45, Member=flatten_5)  # -> Index, Count
clean_2 = CleanTree(RemoveNulls=True, RemoveInvalid=True, RemoveEmpty=True, Tree=mindex_8.Index)
clean_3 = CleanTree(RemoveNulls=True, RemoveInvalid=True, RemoveEmpty=True, Tree=mindex_6.Index)
clean_4 = CleanTree(RemoveNulls=True, RemoveInvalid=True, RemoveEmpty=True, Tree=mindex_7.Index)
clean_5 = CleanTree(RemoveNulls=True, RemoveInvalid=True, RemoveEmpty=True, Tree=mindex_5.Index)
replace_4 = ReplaceItems(List=clean_4, Item="0", Indices="0", Wrap=False)
replace_5 = ReplaceItems(List=clean_2, Item="1", Indices="0", Wrap=False)
replace_6 = ReplaceItems(List=clean_5, Item="2", Indices="0", Wrap=False)
replace_7 = ReplaceItems(List=clean_3, Item="3", Indices="0", Wrap=False)
merge_5 = Merge(Data1=replace_4, Data2=replace_5, Data3=replace_6, Data4=replace_7)
item_20 = ListItem(List=vec_4, Index=merge_5, Wrap=True)
amp_5 = Amplitude(Vector=item_20, Amplitude=combine.Result)
vdis_2 = VectorDisplay(Anchor=pt_7, Vector=amp_5)

# ---- group: vector match method 0 Error
# left-down;x-axis
# left-up;y-axis
a = Number(complex_8.Real)
y_2 = Number(complex_9.Imaginary)
x_2 = Number(complex_9.Real)
b = Number(complex_8.Imaginary)
item_21 = ListItem(List=vec_4, Index=item_16.Item1, Wrap=True)
smaller = SmallerThan(FirstNumber=b, SecondNumber=y_2)  # -> SmallerThan, OrEqualTo
not = GateNot(A=smaller.SmallerThan)
smaller_2 = SmallerThan(FirstNumber=a, SecondNumber=x_2)  # -> SmallerThan, OrEqualTo
and = GateAnd(A=smaller_2.SmallerThan, B=not)
equals_2 = Equality(FirstNumber="0", SecondNumber=graft(int_3))  # -> Equality, Inequality
equals_3 = Equality(FirstNumber="2", SecondNumber=graft(int_3))  # -> Equality, Inequality
and_2 = GateAnd(A=smaller_2.SmallerThan, B=smaller.SmallerThan)
equals_4 = Equality(FirstNumber="1", SecondNumber=graft(int_3))  # -> Equality, Inequality
equals_5 = Equality(FirstNumber="3", SecondNumber=graft(int_3))  # -> Equality, Inequality
or = GateOr(A=equals_2.Equality, B=equals_3.Equality)
or_2 = GateOr(A=equals_4.Equality, B=equals_5.Equality)
and_3 = GateAnd(A=or_2, B=and_2)
and_4 = GateAnd(A=or, B=and)
or_3 = GateOr(A=and_3, B=and_4)
sift_2 = SiftPattern(List=item_21, SiftPattern=or_3)  # -> Output0, Output1
pi_2 = Pi(Factor="0.5")
Z = UnitZ(Factor=1)
neg_3 = Negative(Value=pi_2)
vrot = Rotate(Vector=sift_2.Output0, Axis=Z, Angle=neg_3)
vrot_2 = Rotate(Vector=sift_2.Output1, Axis=Z, Angle=pi_2)
combine_2 = CombineData(Input0=vrot, Input1=vrot_2)  # -> Result, Index
amp_6 = Amplitude(Vector=combine_2.Result, Amplitude=combine.Result)
vdis_3 = VectorDisplay(Anchor=pt_7, Vector=amp_6)

# ----
# vectors between points and space boundary
panel_47 = Panel("0.5")  # disabled
item_22 = ListItem(List=vec_4, Index=item_16.Item1, Wrap=True)  # disabled
pi_3 = Pi(Factor=panel_47)  # disabled
neg_4 = Negative(Value=pi_3)  # disabled
Z_2 = UnitZ(Factor=1)  # disabled
vrot_3 = Rotate(Vector=item_22, Axis=Z_2, Angle=neg_4)  # disabled
amp_7 = Amplitude(Vector=vrot_3, Amplitude=combine.Result)  # disabled

panel_48 = Panel(eval)
panel_49 = Panel(combine.Result)

# ----
# kernel intersection algorithm 002_trial
# explore a point position in space
# 0 --> extend one line to intersect two lines
# 1 --> extend two lines
# 2 --> extend three lines
line_8 = Line([Line((-24.40860271, -49.55265212, 0), (8.180806958, -33.66531491, 0)), Line((-1.799699753, -27.75848441, 0), (-1.799699753, -50.36738737, 0))])  # disabled
panel_50 = Panel("1")  # disabled
linelist_2 = Curve(line_8)  # disabled
lng_5 = ListLength(List=linelist_2)  # disabled
subtraction_9 = Subtraction(A=lng_5, B=panel_50)  # disabled
series_7 = Series(Start=0, Step=1, Count=subtraction_9)  # disabled
addition_9 = Addition(A=series_7, B=panel_50)  # disabled
item_23 = ListItem(List=linelist_2, Index=series_7, Wrap=False)  # -> simplify(graft(Item)); disabled
shift_11 = ShiftList(List=linelist_2, Shift=addition_9, Wrap=False)  # -> simplify(List); disabled
end_4 = EndPoints(Curve=item_23)  # -> Start, End; disabled
end_5 = EndPoints(Curve=shift_11)  # -> Start, End; disabled
end_6 = EndPoints(Curve=linelist_2)  # -> Start, End; disabled
panel_51 = Panel("1")  # disabled
panel_52 = Panel("1")  # disabled
number_slider_5 = Slider(6, range=0..100)  # disabled
panel_53 = Panel("0")  # disabled
panel_54 = Panel("0")  # disabled
panel_55 = Panel("处理k不存在的情况")  # disabled
equals_6 = Equality()  # -> Equality, Inequality; disabled
panel_56 = Panel("2")  # disabled
xy = XYPlane(Origin=Point(0, 0, 0))  # disabled

subtraction_10 = Subtraction(A=end_6.End, B=end_6.Start)  # disabled
startpoint_3 = Point(end_6.Start)  # disabled

vec_5 = Vector(subtraction_10)  # disabled
addition_10 = Addition(A=startpoint_3, B=vec_5)  # disabled
endpoint_2 = Point(addition_10)  # disabled
lng_6 = ListLength(List=addition_10)  # disabled
lng_7 = ListLength(List=startpoint_3)  # disabled
panel_57 = Panel(startpoint_3)  # disabled
subtraction_11 = Subtraction(A=lng_6, B=panel_51)  # disabled
subtraction_12 = Subtraction(A=lng_7, B=panel_52)  # disabled
series_8 = Series(Start=0, Step=1, Count=subtraction_12)  # disabled
series_9 = Series(Start=0, Step=1, Count=subtraction_11)  # disabled
addition_11 = Addition(A=series_9, B=panel_51)  # disabled
addition_12 = Addition(A=series_8, B=panel_52)  # disabled
item_24 = ListItem(List=startpoint_3, Index=series_8, Wrap=False)  # -> simplify(graft(Item)); disabled
item_25 = ListItem(List=addition_10, Index=series_9, Wrap=False)  # -> simplify(graft(Item)); disabled
shift_12 = ShiftList(List=addition_10, Shift=addition_11, Wrap=False)  # -> simplify(List); disabled
shift_13 = ShiftList(List=startpoint_3, Shift=addition_12, Wrap=False)  # -> simplify(List); disabled
firstpt1 = Point(shift_13)  # disabled
firstpt0_2 = Point(item_24)  # disabled
endpt0_2 = Point(item_25)  # disabled
endpt1 = Point(shift_12)  # disabled
points = PointList(Points=flatten(firstpt0_2), Size=number_slider_5)  # disabled
panel_58 = Panel(firstpt0_2)  # disabled
complex_11 = ComplexComponents(Complex=firstpt1)  # -> Real, Imaginary; disabled
complex_12 = ComplexComponents(Complex=endpt1)  # -> Real, Imaginary; disabled
complex_13 = ComplexComponents(Complex=firstpt0_2)  # -> Real, Imaginary; disabled
complex_14 = ComplexComponents(Complex=endpt0_2)  # -> Real, Imaginary; disabled
subtraction_13 = Subtraction(A=complex_11.Imaginary, B=complex_12.Imaginary)  # disabled
subtraction_14 = Subtraction(A=complex_13.Real, B=complex_14.Real)  # disabled
equals_7 = Equality(FirstNumber=subtraction_14, SecondNumber=panel_54)  # -> Equality, Inequality; disabled
sift_3 = SiftPattern(List=complex_13.Real, SiftPattern=equals_7.Equality)  # -> Output0, Output1; disabled
subtraction_15 = Subtraction(A=complex_11.Real, B=complex_12.Real)  # disabled
equals_8 = Equality(FirstNumber=subtraction_15, SecondNumber=panel_53)  # -> Equality, Inequality; disabled
sift_4 = SiftPattern(List=complex_12.Real, SiftPattern=equals_8.Equality)  # -> Output0, Output1; disabled
subtraction_16 = Subtraction(A=complex_13.Imaginary, B=complex_14.Imaginary)  # disabled
combine_3 = CombineData(Input0=sift_3.Output1, Input1=sift_4.Output1)  # -> Result, Index; disabled
panel_59 = Panel(complex_13.Real)  # disabled
division_3 = Division(A=subtraction_13, B=subtraction_15)  # disabled
division_4 = Division(A=subtraction_16, B=subtraction_14)  # disabled
panel_60 = Panel(subtraction_15)  # disabled
panel_61 = Panel(equals_8.Equality)  # disabled
k1_2 = Number(division_4)  # disabled
multiplication_2 = Multiplication(A=k1_2, B=complex_14.Real)  # disabled
k2 = Number(division_3)  # disabled
multiplication_3 = Multiplication(A=k2, B=complex_12.Real)  # disabled
subtraction_17 = Subtraction(A=complex_14.Imaginary, B=multiplication_2)  # disabled
panel_62 = Panel(k1_2)  # disabled
subtraction_18 = Subtraction(A=complex_12.Imaginary, B=multiplication_3)  # disabled
subtraction_19 = Subtraction(A=k1_2, B=k2)  # disabled
b1_2 = Number(subtraction_17)  # disabled
dom = ConstructDomain(DomainStart=complex_13.Real, DomainEnd=complex_14.Real)  # disabled
b2 = Number(subtraction_18)  # disabled
dom_2 = ConstructDomain(DomainStart=complex_11.Real, DomainEnd=complex_12.Real)  # disabled
subtraction_20 = Subtraction(A=b2, B=b1_2)  # disabled
nullrep = ReplaceNulls(Items=k1_2, Replacements=complex_13.Real)  # -> Items, Count; disabled
division_5 = Division(A=subtraction_20, B=subtraction_19)  # disabled
panel_63 = Panel(division_5)  # disabled
inc = Includes(Value=division_5, Domain=dom)  # -> Includes, Deviation; disabled
inc_2 = Includes(Value=division_5, Domain=dom_2)  # -> Includes, Deviation; disabled
multiplication_4 = Multiplication(A=division_5, B=k2)  # disabled
panel_64 = Panel(nullrep.Items)  # disabled
nullrep_2 = ReplaceNulls(Items=division_5, Replacements=combine_3.Result)  # -> Items, Count; disabled
int_7 = Integer(inc.Includes)  # disabled
addition_13 = Addition(A=multiplication_4, B=b2)  # disabled
int_8 = Integer(inc_2.Includes)  # disabled
addition_14 = Addition(A=int_7, B=int_8)  # disabled
subtraction_21 = Subtraction(A=panel_56, B=addition_14)  # disabled
extendlinecount = Integer(subtraction_21)  # disabled
intersection_x = Number(division_5)  # disabled
intersection_y = Number(addition_13)  # disabled
pt_9 = PointOriented(BasePlane=xy, UComponent=intersection_x, VComponent=intersection_y, WComponent=0)  # disabled
panel_65 = Panel(extendlinecount)  # disabled
sift_5 = SiftPattern(List=pt_9, SiftPattern=extendlinecount)  # -> Output0, Output1, Output2; disabled
intersectionontwolines = Point(sift_5.Output0)  # disabled
intersectionononeline = Point(sift_5.Output1)  # disabled
intersectiononextend = Point(sift_5.Output2)  # disabled

xy_2 = XYPlane(Origin=Point(0, 0, 0))  # disabled
sift_6 = SiftPattern(List=division_5, SiftPattern=extendlinecount)  # -> Output0, Output1, Output2; disabled
sift_7 = SiftPattern(List=addition_13, SiftPattern=extendlinecount)  # -> Output0, Output1, Output2; disabled
pt_10 = PointOriented(BasePlane=xy_2, UComponent=sift_6.Output0, VComponent=sift_7.Output0, WComponent=0)  # disabled
flatten_6 = FlattenTree(Tree=pt_10, Path="{0}")  # disabled
clean_6 = CleanTree(RemoveNulls=True, RemoveInvalid=True, RemoveEmpty=False, Tree=flatten_6)  # disabled
pt_11 = Point(Point(-2.015690168, -16.36521091, 0))  # disabled
panel_66 = Panel("2")  # disabled
partition = PartitionList(List=clean_6, Size=panel_66)  # disabled
bang_2 = ExplodeTree(Data=partition)  # -> Branch0, Branch1; disabled
rev = ReverseList(List=bang_2.Branch1)  # disabled
merge_6 = Merge(Data1=bang_2.Branch0, Data2=rev)  # -> flatten(Result); disabled
pline_3 = PolyLine(Vertices=merge_6, Closed=True)  # disabled

end_7 = EndPoints(Curve=linelist)  # -> Start, End; disabled
subtraction_22 = Subtraction(A=end_7.End, B=end_7.Start)  # disabled
startpoint_4 = Point(end_7.Start)  # disabled
vec_6 = Vector(subtraction_22)  # disabled
addition_15 = Addition(A=startpoint_4, B=vec_6)  # disabled
endpoint_3 = Point(addition_15)  # disabled
lng_8 = ListLength(List=addition_15)  # disabled
lng_9 = ListLength(List=startpoint_4)  # disabled
panel_67 = Panel("1")  # disabled
panel_68 = Panel(startpoint_4)  # disabled
panel_69 = Panel("1")  # disabled
subtraction_23 = Subtraction(A=lng_8, B=panel_67)  # disabled
subtraction_24 = Subtraction(A=lng_9, B=panel_69)  # disabled
series_10 = Series(Start=0, Step=1, Count=subtraction_24)  # disabled
series_11 = Series(Start=0, Step=1, Count=subtraction_23)  # disabled
addition_16 = Addition(A=series_11, B=panel_67)  # disabled
addition_17 = Addition(A=series_10, B=panel_69)  # disabled
number_slider_6 = Slider(6, range=0..100)  # disabled
item_26 = ListItem(List=startpoint_4, Index=series_10, Wrap=False)  # -> simplify(graft(Item)); disabled
item_27 = ListItem(List=addition_15, Index=series_11, Wrap=False)  # -> simplify(graft(Item)); disabled
shift_14 = ShiftList(List=addition_15, Shift=addition_16, Wrap=False)  # -> simplify(List); disabled
shift_15 = ShiftList(List=startpoint_4, Shift=addition_17, Wrap=False)  # -> simplify(List); disabled
firstpt1_2 = Point(shift_15)  # disabled
firstpt0_3 = Point(item_26)  # disabled
endpt0_3 = Point(item_27)  # disabled
endpt1_2 = Point(shift_14)  # disabled
points_2 = PointList(Points=flatten(firstpt0_3), Size=number_slider_6)  # disabled
complex_15 = ComplexComponents(Complex=endpt1_2)  # -> Real, Imaginary; disabled
complex_16 = ComplexComponents(Complex=firstpt1_2)  # -> Real, Imaginary; disabled
complex_17 = ComplexComponents(Complex=firstpt0_3)  # -> Real, Imaginary; disabled
complex_18 = ComplexComponents(Complex=endpt0_3)  # -> Real, Imaginary; disabled
subtraction_25 = Subtraction(A=complex_17.Real, B=complex_18.Real)  # disabled
subtraction_26 = Subtraction(A=complex_17.Imaginary, B=complex_18.Imaginary)  # disabled
subtraction_27 = Subtraction(A=complex_16.Real, B=complex_15.Real)  # disabled
subtraction_28 = Subtraction(A=complex_16.Imaginary, B=complex_15.Imaginary)  # disabled
division_6 = Division(A=subtraction_26, B=subtraction_25)  # disabled
division_7 = Division(A=subtraction_28, B=subtraction_27)  # disabled
k2_2 = Number(division_7)  # disabled
multiplication_5 = Multiplication(A=k2_2, B=complex_15.Real)  # disabled
k1_3 = Number(division_6)  # disabled
multiplication_6 = Multiplication(A=k1_3, B=complex_18.Real)  # disabled
subtraction_29 = Subtraction(A=complex_18.Imaginary, B=multiplication_6)  # disabled
subtraction_30 = Subtraction(A=complex_15.Imaginary, B=multiplication_5)  # disabled
subtraction_31 = Subtraction(A=k1_3, B=k2_2)  # disabled
b1_3 = Number(subtraction_29)  # disabled
b2_2 = Number(subtraction_30)  # disabled
subtraction_32 = Subtraction(A=b2_2, B=b1_3)  # disabled
division_8 = Division(A=subtraction_32, B=subtraction_31)  # disabled
multiplication_7 = Multiplication(A=division_8, B=k2_2)  # disabled
addition_18 = Addition(A=multiplication_7, B=b2_2)  # disabled
xy_3 = XYPlane(Origin=Point(0, 0, 0))  # disabled
intersection_x_2 = Number(division_8)  # disabled
intersection_y_2 = Number(addition_18)  # disabled
xy_4 = XYPlane(Origin=Point(0, 0, 0))  # disabled
pt_12 = PointOriented(BasePlane=xy_4, UComponent=intersection_x_2, VComponent=intersection_y_2, WComponent=0)  # disabled

# ----
# 0 --> extend one line to intersect two lines
# 1 --> extend two lines
# 2 --> extend three lines
dom_3 = ConstructDomain(DomainStart=complex_16.Real, DomainEnd=complex_15.Real)  # disabled
dom_4 = ConstructDomain(DomainStart=complex_17.Real, DomainEnd=complex_18.Real)  # disabled
inc_3 = Includes(Value=division_8, Domain=dom_4)  # -> Includes, Deviation; disabled
inc_4 = Includes(Value=division_8, Domain=dom_3)  # -> Includes, Deviation; disabled
int_9 = Integer(inc_3.Includes)  # disabled
int_10 = Integer(inc_4.Includes)  # disabled
addition_19 = Addition(A=int_9, B=int_10)  # disabled
panel_70 = Panel("2")  # disabled
subtraction_33 = Subtraction(A=panel_70, B=addition_19)  # disabled
extendlinecount_2 = Integer(subtraction_33)  # disabled

sift_8 = SiftPattern(List=addition_18, SiftPattern=extendlinecount_2)  # -> Output0, Output1, Output2; disabled
sift_9 = SiftPattern(List=division_8, SiftPattern=extendlinecount_2)  # -> Output0, Output1, Output2; disabled
pt_13 = PointOriented(BasePlane=xy_3, UComponent=sift_9.Output0, VComponent=sift_8.Output0, WComponent=0)  # disabled
flatten_7 = FlattenTree(Tree=pt_13, Path="{0}")  # disabled
clean_7 = CleanTree(RemoveNulls=True, RemoveInvalid=True, RemoveEmpty=False, Tree=flatten_7)  # disabled
panel_71 = Panel(extendlinecount_2)  # disabled
sift_10 = SiftPattern(List=pt_12, SiftPattern=extendlinecount_2)  # -> Output0, Output1, Output2; disabled
intersectionontwolines_2 = Point(sift_10.Output0)  # disabled
intersectionononeline_2 = Point(sift_10.Output1)  # disabled
intersectiononextend_2 = Point(sift_10.Output2)  # disabled

# ---- group: vector match method 1 simplify
entwine_3 = Entwine(Branch00=panel_40, Branch01=panel_39, Branch02=panel_41, Branch03=panel_42, FlattenInputs=True)  # -> simplify(Result)
flatten_8 = FlattenTree(Tree=concat_7, Path="{0}")
mindex_9 = MemberIndex(Set=entwine_3, Member=flatten_8)  # -> Index, Count
clean_8 = CleanTree(RemoveNulls=True, RemoveInvalid=True, RemoveEmpty=True, Tree=mindex_9.Index)
pshift_3 = ShiftPaths(Data=clean_8, Offset=-1)
viewer_4 = ParamViewer(clean_8)

tstat_8 = TreeStatistics(Tree=pshift_3)  # -> Paths, Length, Count
dpath = DeconstructPath(Branch=tstat_8.Paths)  # -> simplify(Indices)

graft_7 = GraftTree(Tree=tstat_8.Length, IncludeEmptyLists=True, IncludeNullItems=True)
series_12 = Series(Start=0, Step=1, Count=graft_7)
int_11 = Integer(simplify(series_12))
replace_8 = ReplaceItems(List=pshift_3, Item=dpath, Indices=int_11, Wrap=False)
graft_8 = GraftTree(Tree=flatten(replace_8), IncludeEmptyLists=True, IncludeNullItems=True)
viewer_5 = ParamViewer(graft_8)
replace_9 = ReplacePaths(Data=graft_8, Search=viewer_5, Replace=viewer_4)
pshift_4 = ShiftPaths(Data=replace_9, Offset="1")
item_28 = ListItem(List=vec_4, Index=pshift_4, Wrap=True)
amp_8 = Amplitude(Vector=item_28, Amplitude=combine.Result)
vdis_4 = VectorDisplay(Anchor=pt_7, Vector=amp_8)

# ----
# explore a point position in space
line_9 = Line([Line((120.3761888, -60.82999189, 0), (120.4261985, -60.77899512, 0)), Line((120.4071159, -60.77735006, 0), (120.4317917, -60.84644247, 0)), Line((120.3676345, -60.80070987, 0), (120.440017, -60.81387033, 0))])
panel_72 = Panel("""处理k不存在的情况

写成函数
把坐标在相减后就分开来算

对实交和虚交的算法 不够缜密""")
# debug:可以做，但是要改动很多，先放放，出现问题了再来
linelist_3 = Curve(line_9)
end_8 = EndPoints(Curve=linelist_3)  # -> Start, End
subtraction_34 = Subtraction(A=end_8.End, B=end_8.Start)
xy_5 = XYPlane(Origin=Point(0, 0, 0))

startpoint_5 = Point(end_8.Start)
vec_7 = Vector(subtraction_34)

addition_20 = Addition(A=startpoint_5, B=vec_7)
endpoint_4 = Point(addition_20)
lng_10 = ListLength(List=addition_20)
lng_11 = ListLength(List=startpoint_5)
subtraction_35 = Subtraction(A=lng_10, B="1")
subtraction_36 = Subtraction(A=lng_11, B="1")
series_13 = Series(Start=0, Step=1, Count=subtraction_36)
series_14 = Series(Start=0, Step=1, Count=subtraction_35)
addition_21 = Addition(A=series_13, B="1")
addition_22 = Addition(A=series_14, B="1")
item_29 = ListItem(List=startpoint_5, Index=series_13, Wrap=False)  # -> simplify(graft(Item))
item_30 = ListItem(List=addition_20, Index=series_14, Wrap=False)  # -> simplify(graft(Item))
shift_16 = ShiftList(List=addition_20, Shift=addition_22, Wrap=False)  # -> simplify(List)
shift_17 = ShiftList(List=startpoint_5, Shift=addition_21, Wrap=False)  # -> simplify(List)

firstpt_line0_2 = Point(item_29)
firstpt_line1_2 = Point(shift_17)
endpt1_line1 = Point(shift_16)
endpt_line0_2 = Point(item_30)

points_3 = PointList(Points=flatten(firstpt_line0_2), Size=Slider(6, range=0..100))

complex_19 = ComplexComponents(Complex=firstpt_line1_2)  # -> Real, Imaginary
complex_20 = ComplexComponents(Complex=endpt1_line1)  # -> Real, Imaginary
complex_21 = ComplexComponents(Complex=endpt_line0_2)  # -> Real, Imaginary
complex_22 = ComplexComponents(Complex=firstpt_line0_2)  # -> Real, Imaginary
subtraction_37 = Subtraction(A=complex_19.Imaginary, B=complex_20.Imaginary)
subtraction_38 = Subtraction(A=complex_19.Real, B=complex_20.Real)
subtraction_39 = Subtraction(A=complex_22.Real, B=complex_21.Real)
subtraction_40 = Subtraction(A=complex_22.Imaginary, B=complex_21.Imaginary)
division_9 = Division(A=subtraction_37, B=subtraction_38)
division_10 = Division(A=subtraction_40, B=subtraction_39)
k1_4 = Number(division_10)
k2_3 = Number(division_9)
multiplication_8 = Multiplication(A=k2_3, B=complex_19.Real)
subtraction_41 = Subtraction(A=complex_19.Imaginary, B=multiplication_8)
b2_3 = Number(subtraction_41)
subtraction_42 = Subtraction(A=k1_4, B=k2_3)

dom_5 = ConstructDomain(DomainStart=complex_22.Real, DomainEnd=complex_21.Real)
dom_6 = ConstructDomain(DomainStart=complex_22.Imaginary, DomainEnd=complex_21.Imaginary)
dom_7 = ConstructDomain(DomainStart=complex_19.Real, DomainEnd=complex_20.Real)
dom_8 = ConstructDomain(DomainStart=complex_19.Imaginary, DomainEnd=complex_20.Imaginary)

multiplication_9 = Multiplication(A=k1_4, B=complex_22.Real)
subtraction_43 = Subtraction(A=complex_22.Imaginary, B=multiplication_9)

equals_9 = Equality(FirstNumber=subtraction_38, SecondNumber="0")  # -> Equality, Inequality
equals_10 = Equality(FirstNumber=subtraction_39, SecondNumber="0")  # -> Equality, Inequality
sift_11 = SiftPattern(List=complex_20.Real, SiftPattern=equals_9.Equality)  # -> Output0, Output1
sift_12 = SiftPattern(List=complex_22.Real, SiftPattern=equals_10.Equality)  # -> Output0, Output1
or_4 = GateOr(A=equals_10.Equality, B=equals_9.Equality)
combine_4 = CombineData(Input0=sift_12.Output1, Input1=sift_11.Output1)  # -> Result, Index
sift_13 = SiftPattern(List=k2_3, SiftPattern=equals_9.Equality)  # -> Output0, Output1
sift_14 = SiftPattern(List=b2_3, SiftPattern=equals_9.Equality)  # -> Output0, Output1
sift_15 = SiftPattern(List=k1_4, SiftPattern=equals_10.Equality)  # -> Output0, Output1
combine_5 = CombineData(Input0=sift_15.Output0, Input1=sift_13.Output0)  # -> Result, Index
a_2 = Number(combine_4.Result)
k = Number(combine_5.Result)
multiplication_10 = Multiplication(A=a_2, B=k)
intersection_x_3 = Number(a_2)

b1_4 = Number(subtraction_43)
subtraction_44 = Subtraction(A=b2_3, B=b1_4)
division_11 = Division(A=subtraction_44, B=subtraction_42)
multiplication_11 = Multiplication(A=division_11, B=k2_3)
addition_23 = Addition(A=multiplication_11, B=b2_3)
sift_16 = SiftPattern(List=addition_23, SiftPattern=or_4)  # -> Output0, Output1

sift_17 = SiftPattern(List=b1_4, SiftPattern=equals_10.Equality)  # -> Output0, Output1
combine_6 = CombineData(Input0=sift_17.Output0, Input1=sift_14.Output0)  # -> Result, Index
b_2 = Number(combine_6.Result)
sift_18 = SiftPattern(List=b_2, SiftPattern=or_4)  # -> Output0, Output1
addition_24 = Addition(A=multiplication_10, B=sift_18.Output1)
intersection_y_3 = Number(addition_24)

combine_7 = CombineData(Input0=sift_16.Output0, Input1=intersection_y_3)  # -> Result, Index
combine_8 = CombineData(Input0=division_11, Input1=intersection_x_3)  # -> Result, Index

panel_73 = Panel(equals_10.Equality)
intersection_x_4 = Number(combine_8.Result)
intersection_y_4 = Number(combine_7.Result)
pt_14 = PointOriented(BasePlane=xy_5, UComponent=intersection_x_4, VComponent=intersection_y_4, WComponent=0)

# ----
# true --> real insection
# false --> extend
# 10,11 --> real insection
# 01       --> extend one line
# 00       --> extend two lines
# true   -- > extend one line
# false -->  extend two lines
dom_9 = ConstructDomain(DomainStart=complex_22.Imaginary, DomainEnd=complex_21.Imaginary)
dom_10 = ConstructDomain(DomainStart=complex_22.Real, DomainEnd=complex_21.Real)
dom_11 = ConstructDomain(DomainStart=complex_19.Real, DomainEnd=complex_20.Real)
dom_12 = ConstructDomain(DomainStart=complex_19.Imaginary, DomainEnd=complex_20.Imaginary)
firstpty_domain = Domain(dom_9)
firstptx_domain = Domain(dom_10)
endpty_domain = Domain(dom_12)
endptx_domain = Domain(dom_11)
inc_5 = Includes(Value=intersection_y_4, Domain=firstpty_domain)  # -> Includes, Deviation
inc_6 = Includes(Value=intersection_x_4, Domain=endptx_domain)  # -> Includes, Deviation
inc_7 = Includes(Value=intersection_y_4, Domain=endpty_domain)  # -> Includes, Deviation
inc_8 = Includes(Value=intersection_x_4, Domain=firstptx_domain)  # -> Includes, Deviation
or_5 = GateOr(A=inc_8.Includes, B=inc_5.Includes, C=inc_6.Includes, D=inc_7.Includes)
and_5 = GateAnd(A=inc_8.Includes, B=inc_5.Includes, C=inc_6.Includes, D=inc_7.Includes)
int_12 = Integer(or_5)
int_13 = Integer(and_5)
concat_8 = Concatenate(FragmentA=int_13, FragmentB=int_12)
panel_74 = Panel("""10
11
01
00""")
panel_75 = Panel("""0
0
1
2""")
keysearch = KeyValueSearch(Keys=panel_74, Values=panel_75, Search=concat_8)
extendlinecount_3 = Integer(keysearch)

# ----
# k1=k2,b1=b2 --> common line -->point or line
equals_11 = Equality(FirstNumber=k1_4, SecondNumber=k2_3)  # -> Equality, Inequality; disabled
equals_12 = Equality(FirstNumber=b1_4, SecondNumber=b2_3)  # -> Equality, Inequality; disabled
and_6 = GateAnd(A=equals_11.Equality, B=equals_12.Equality)  # disabled
dedomain = DeconstructDomain(Domain=firstptx_domain)  # -> Start, End; disabled
dedomain_2 = DeconstructDomain(Domain=firstpty_domain)  # -> Start, End; disabled
dedomain_3 = DeconstructDomain(Domain=endptx_domain)  # -> Start, End; disabled
dedomain_4 = DeconstructDomain(Domain=endpty_domain)  # -> Start, End; disabled
merge_7 = Merge(Data1=dedomain.Start, Data2=dedomain.End, Data3=dedomain_3.Start, Data4=dedomain_3.End)  # disabled
merge_8 = Merge(Data1=dedomain_2.Start, Data2=dedomain_2.End, Data3=dedomain_4.Start, Data4=dedomain_4.End)  # disabled
sort_2 = SortList(Keys=merge_7)  # -> Keys, ValuesA; disabled
sort_3 = SortList(Keys=merge_8)  # -> Keys, ValuesA; disabled
panel_76 = Panel("1")  # disabled
panel_77 = Panel("1")  # disabled
item_31 = ListItem(List=sort_2.Keys, Index=panel_76, Wrap=False)  # -> Item, Item1; disabled
item_32 = ListItem(List=sort_3.Keys, Index=panel_77, Wrap=False)  # -> Item, Item1; disabled
panel_78 = Panel("2")  # disabled
panel_79 = Panel("2")  # disabled
addition_25 = Addition(A=item_32.Item, B=item_32.Item1)  # disabled
addition_26 = Addition(A=item_31.Item, B=item_31.Item1)  # disabled
division_12 = Division(A=addition_25, B=panel_79)  # disabled
division_13 = Division(A=addition_26, B=panel_78)  # disabled

sift_19 = SiftPattern(List=pt_14, SiftPattern=extendlinecount_3)  # -> Output0, Output1, Output2
intersectionontwolines_3 = Point(sift_19.Output0)
intersectionononeline_3 = Point(sift_19.Output1)
intersectiononextend_3 = Point(sift_19.Output2)
panel_80 = Panel(intersectionontwolines_3)

firstpt0_4 = Point(firstpt_line0)
firstpt1_3 = Point(firstpt_line1)
endpt0_4 = Point(endpt_line0)
endpt1_3 = Point(endpt_line1)
points_4 = PointList(Points=flatten(firstpt0_4), Size=Slider(0.109, range=0..3))
complex_23 = ComplexComponents(Complex=firstpt0_4)  # -> Real, Imaginary
complex_24 = ComplexComponents(Complex=firstpt1_3)  # -> Real, Imaginary
complex_25 = ComplexComponents(Complex=endpt1_3)  # -> Real, Imaginary
complex_26 = ComplexComponents(Complex=endpt0_4)  # -> Real, Imaginary
subtraction_45 = Subtraction(A=complex_24.Imaginary, B=complex_25.Imaginary)
subtraction_46 = Subtraction(A=complex_24.Real, B=complex_25.Real)
equals_13 = Equality(FirstNumber=subtraction_46, SecondNumber="0")  # -> Equality, Inequality
sift_20 = SiftPattern(List=complex_25.Real, SiftPattern=equals_13.Equality)  # -> Output0, Output1
subtraction_47 = Subtraction(A=complex_23.Imaginary, B=complex_26.Imaginary)
subtraction_48 = Subtraction(A=complex_23.Real, B=complex_26.Real)
equals_14 = Equality(FirstNumber=subtraction_48, SecondNumber="0")  # -> Equality, Inequality
sift_21 = SiftPattern(List=complex_23.Real, SiftPattern=equals_14.Equality)  # -> Output0, Output1
or_6 = GateOr(A=equals_14.Equality, B=equals_13.Equality)
combine_9 = CombineData(Input0=sift_21.Output1, Input1=sift_20.Output1)  # -> Result, Index
division_14 = Division(A=subtraction_45, B=subtraction_46)
division_15 = Division(A=subtraction_47, B=subtraction_48)
panel_81 = Panel("""处理k不存在的情况

写成函数
把坐标在相减后就分开来算""")
k1_5 = Number(division_15)
multiplication_12 = Multiplication(A=k1_5, B=complex_23.Real)
sift_22 = SiftPattern(List=k1_5, SiftPattern=equals_14.Equality)  # -> Output0, Output1
subtraction_49 = Subtraction(A=complex_23.Imaginary, B=multiplication_12)
b1_5 = Number(subtraction_49)
sift_23 = SiftPattern(List=b1_5, SiftPattern=equals_14.Equality)  # -> Output0, Output1
k2_4 = Number(division_14)
multiplication_13 = Multiplication(A=k2_4, B=complex_24.Real)
sift_24 = SiftPattern(List=k2_4, SiftPattern=equals_13.Equality)  # -> Output0, Output1
subtraction_50 = Subtraction(A=complex_24.Imaginary, B=multiplication_13)
combine_10 = CombineData(Input0=sift_22.Output0, Input1=sift_24.Output0)  # -> Result, Index
b2_4 = Number(subtraction_50)
sift_25 = SiftPattern(List=b2_4, SiftPattern=equals_13.Equality)  # -> Output0, Output1
combine_11 = CombineData(Input0=sift_23.Output0, Input1=sift_25.Output0)  # -> Result, Index
subtraction_51 = Subtraction(A=b2_4, B=b1_5)
b_3 = Number(combine_11.Result)
a_3 = Number(combine_9.Result)
k_2 = Number(combine_10.Result)
subtraction_52 = Subtraction(A=k1_5, B=k2_4)
sift_26 = SiftPattern(List=b_3, SiftPattern=or_6)  # -> Output0, Output1
multiplication_14 = Multiplication(A=a_3, B=k_2)
division_16 = Division(A=subtraction_51, B=subtraction_52)
multiplication_15 = Multiplication(A=division_16, B=k2_4)
addition_27 = Addition(A=multiplication_15, B=b2_4)
sift_27 = SiftPattern(List=addition_27, SiftPattern=or_6)  # -> Output0, Output1
addition_28 = Addition(A=multiplication_14, B=sift_26.Output1)
intersection_x_5 = Number(a_3)
intersection_y_5 = Number(addition_28)
combine_12 = CombineData(Input0=sift_27.Output0, Input1=intersection_y_5)  # -> Result, Index
combine_13 = CombineData(Input0=division_16, Input1=intersection_x_5)  # -> Result, Index
intersection_x_6 = Number(combine_13.Result)
intersection_y_6 = Number(combine_12.Result)
xy_6 = XYPlane(Origin=Point(0, 0, 0))
pt_15 = PointOriented(BasePlane=xy_6, UComponent=intersection_x_6, VComponent=intersection_y_6, WComponent=0)

# ----
# true --> real insection
# false --> extend
# 10,11 --> real insection
# 01       --> extend one line
# 00       --> extend two lines
# true   -- > extend one line
# false -->  extend two lines
dom_13 = ConstructDomain(DomainStart=complex_23.Imaginary, DomainEnd=complex_26.Imaginary)
dom_14 = ConstructDomain(DomainStart=complex_23.Real, DomainEnd=complex_26.Real)
dom_15 = ConstructDomain(DomainStart=complex_24.Real, DomainEnd=complex_25.Real)
dom_16 = ConstructDomain(DomainStart=complex_24.Imaginary, DomainEnd=complex_25.Imaginary)
firstpty_domain_2 = Domain(dom_13)
firstptx_domain_2 = Domain(dom_14)
endpty_domain_2 = Domain(dom_16)
endptx_domain_2 = Domain(dom_15)
inc_9 = Includes(Value=intersection_y_6, Domain=firstpty_domain_2)  # -> Includes, Deviation
inc_10 = Includes(Value=intersection_x_6, Domain=endptx_domain_2)  # -> Includes, Deviation
inc_11 = Includes(Value=intersection_y_6, Domain=endpty_domain_2)  # -> Includes, Deviation
inc_12 = Includes(Value=intersection_x_6, Domain=firstptx_domain_2)  # -> Includes, Deviation
or_7 = GateOr(A=inc_12.Includes, B=inc_9.Includes, C=inc_10.Includes, D=inc_11.Includes)
and_7 = GateAnd(A=inc_12.Includes, B=inc_9.Includes, C=inc_10.Includes, D=inc_11.Includes)
int_14 = Integer(and_7)
int_15 = Integer(or_7)
concat_9 = Concatenate(FragmentA=int_14, FragmentB=int_15)
panel_82 = Panel("""10
11
01
00""")
panel_83 = Panel("""0
0
1
2""")
keysearch_2 = KeyValueSearch(Keys=panel_82, Values=panel_83, Search=concat_9)
extendlinecount_4 = Integer(keysearch_2)

sift_28 = SiftPattern(List=pt_15, SiftPattern=extendlinecount_4)  # -> Output0, Output1, Output2
intersectionontwolines_4 = Point(sift_28.Output0)
intersectionononeline_4 = Point(sift_28.Output1)
intersectiononextend_4 = Point(sift_28.Output2)
